# Grasshopper definition CityGML Room Importer.gh (Grasshopper 1.0.7)

# ----
# 操作用
# CityGMLファイルを選択（必須）
# 室名絞込
# Bakeボタン
panel = Panel("")
bake = Button()
ファイル = FilePath("/Users/masamikimatsubara/Downloads/NKT_NKS_ARC_PLN_ZZ_V21_ZZ_.xml")

# ----
# CityGML取込スクリプト
citygmltorooms = GhPythonScript(path=ファイル)  # -> debug_log, ids, names, polylines, centers
# ---------- citygmltorooms: Python ----------
"""Provides a scripting component.
    Inputs:
        path: XML File Path
    Output:
        ids: Array of room id
        names: Array of room name"""

__author__ = "masamiki.matsubara@bSJ"
__version__ = "2022.12.11"

import rhinoscriptsyntax as rs
import xml.etree.ElementTree as ET
from Grasshopper import DataTree
from Grasshopper.Kernel.Data import GH_Path
import System
import Rhino

tree = ET.parse(path)
root = tree.getroot()

room_tag = "{http://www.opengis.net/citygml/building/2.0}Room"
id_attr_name = "{http://www.opengis.net/gml}id"
name_tag = "{http://www.opengis.net/gml}name"
lod4_solid_tag = "{http://www.opengis.net/citygml/building/2.0}lod4Solid"
surface_member_tag = "{http://www.opengis.net/gml}surfaceMember"
orientable_surface_tag = "{http://www.opengis.net/gml}OrientableSurface"
base_surface_tag = "{http://www.opengis.net/gml}baseSurface"
href_attr_name = "{http://www.w3.org/1999/xlink}href"
polygon_tag = "{http://www.opengis.net/gml}Polygon"
pos_list_tag = "{http://www.opengis.net/gml}posList"

ids = DataTree[System.String]()
names = DataTree[System.String]()
polylines = DataTree[System.Guid]()
centers = DataTree[Rhino.Geometry.Point3d]()

# surfaces = []
for index, room in enumerate(root.iter(room_tag)):
    if id_attr_name in room.attrib:
        id = room.get(id_attr_name)
        ids.Add(id, GH_Path(index))
    else:
        ids.Add(None, GH_Path(index))
    name_node = room.find(name_tag)
    if name_node is not None:
        name = room.find(name_tag).text
        names.Add(name, GH_Path(index))
    else:
        names.Add(None, GH_Path(index))
        
    lod4_solid_node = room.find(lod4_solid_tag)
    poly_lines = []
    point_sum = None
    point_count = 0
    for surface_member in lod4_solid_node.iter(surface_member_tag):
        orientable_surface = surface_member.find(orientable_surface_tag)
        base_surface = orientable_surface.find(base_surface_tag)
        href = base_surface.get(href_attr_name)
        path = ".//" + polygon_tag + "[@" + id_attr_name + "='" + href.replace("#", "") + "']"
        for polygon in room.findall(path):
            points = []
            # curves = []
            for pos in polygon.iter(pos_list_tag):
                # current_point = None
                pos_values = pos.text.split(" ")
                for i in range(0, len(pos_values), 3):
                    x = pos_values[i]
                    y = pos_values[i+1]
                    z = pos_values[i+2]
                    point = rs.CreatePoint(float(x), float(y), float(z))
                    # if (current_point != None):
                    #    curves.append(rs.AddLine(current_point, point))
                    if (point_sum != None):
                        point_sum = point_sum + point
                    else:
                        point_sum = point
                    # current_point = point
                    point_count = point_count + 1
                    points.append(point)
            poly_line = rs.AddPolyline(points)
            poly_lines.append(poly_line)
            # surface = rs.AddEdgeSrf(curves)
            # surfaces.append(surface)

    centers.Add(point_sum/point_count, GH_Path(index))
    polylines.AddRange(poly_lines, GH_Path(index))
# ---------- end citygmltorooms ----------
tag = TextTag(Location=citygmltorooms.centers, Text=citygmltorooms.names)

# ----
# 室名一覧
panel_2 = Panel(citygmltorooms.names)

# ----
# 室名での絞り込み
containstr = GhPythonScript(keyword=panel, text=citygmltorooms.names)  # -> result
# ---------- containstr: Python ----------
__author__ = "masamikimatsubara"

import rhinoscriptsyntax as rs
if text == '':
    result = True
else:
    result = keyword in text
# ---------- end containstr ----------
dispatch = Dispatch(List=citygmltorooms.polylines, DispatchPattern=containstr)  # -> マッチした居室, マッチしなかった居室
dispatch_2 = Dispatch(List=citygmltorooms.names, DispatchPattern=containstr)  # -> マッチした居室名, マッチしなかった居室名

tobrep = ToBrep(srf=dispatch.マッチした居室)

# ----
# Bake機能
bakewithattribute = GhPythonScript(breps=tobrep, name=dispatch_2.マッチした居室名, bake=bake)  # inputs breps: list of Brep, bake: Boolean
# ---------- bakewithattribute: Python ----------
"""Provides a scripting component.
    Inputs:
        breps: list of brep
        name: room name
        bake: flag for baking"""

__author__ = "masamikimatsubara"

import rhinoscriptsyntax as rs
import Rhino as rh
import scriptcontext as sc

sc.doc = rh.RhinoDoc.ActiveDoc
if bake and breps is not None:
    for i, brep in enumerate(breps):
        attributes = rh.DocObjects.ObjectAttributes()
        attributes.SetUserString('室名', name)
        sc.doc.Objects.Add(brep, attributes)
# ---------- end bakewithattribute ----------

# ==== cluster ToBrep
srf = ClusterInput()
srf_2 = Surface(srf)
join = BrepJoin(Breps=srf_2)  # -> Breps, Closed
join_2 = BrepJoin(Breps=join.Breps)  # -> Breps, Closed
B = ClusterOutput(join_2.Breps)
